# Dynamo graph Excel import.dyn (Dynamo 2.13.1.3887)

PBI = StringInput("C:\Anatoly\20 ZT\22 Power BI  - summary schedule\Development\Phase 10 - Netto and Brutto\Python\Create schedule from ITWO.py")
file_from_path = FileObject(path=PBI)
readText = FileSystem.ReadText(file=file_from_path)
boolean = BoolSelector(false)
mode = DoubleInput(2)  # graph input
python_script_from_string = PythonStringNode(script=readText, IN[0]=file_from_path, IN[1]=boolean, IN[2]=mode)  # CPython3
string = StringInput("Strabag parameters\n")
number = DoubleInput(0)
boolean_2 = BoolSelector(true)
exportToExcel = Data.ExportToExcel(sheetName=string, startRow=number, startColumn=number, overWrite=boolean_2)  # unwired: filePath, data
revit_tables_parameters = Filename("..\Excel\Tables_parameters")
itwo_parameters = Filename("..\Excel\ITWO_parameters.xlsx")
